% Simulink data dictionary ElectricPowertrain_data.sldd

ContactorsCmds_BUS = Simulink.Bus()
  BContactorsPosRequested: boolean
  BContactorsNegRequested: boolean
  BPrechargeRequested: boolean
  BActiveDischargeRequested: boolean

ControllerCmds_BUS = Simulink.Bus()
  ContactorsCmds: Bus: ContactorsCmds_BUS

TSim = Simulink.Parameter(0.001)
BContPosRequested = Simulink.Parameter(false, DataType="boolean")
BContNegRequested = Simulink.Parameter(false, DataType="boolean")
BPrechargeRequested = Simulink.Parameter(false, DataType="boolean")
BActiveDischargeRequested = Simulink.Parameter(false, DataType="boolean")

PhysicalInputs_BUS = Simulink.Bus()
  BServiceDisconnectPos: boolean
  BServiceDisconnectNeg: boolean

PlantOutput_BUS = Simulink.Bus()
  VCUKIVT: double
  VESDCLink: double
  VESIVT: double

BServiceDisconnectPos = Simulink.Parameter(false, DataType="boolean")
BServiceDisconnectNeg = Simulink.Parameter(false, DataType="boolean")
rInitialSoC = Simulink.Parameter(repmat(65, 1, 228), DataType="double")
rCellCapacity = Simulink.Parameter(repmat(4, 1, 228), DataType="double")